# Dynamo graph A2.창호 일람표 만들기333.dyn (Dynamo 2.12.1.8246)
# packages: spring nodes 210.1.1, Clockwork for Dynamo 2.x 2.12.0, MEPover 2024.9.25, Spoonup 3.5.0, LunchBox for Dynamo 2018.7.7, archi-lab.net 2022.212.3222, Rhythm 2018.12.4

boolean = BoolSelector(true)  # graph input

# group: 1.1 View에 배치된 부재와 viewscale 정보 추출
activeView = Custom[Springs.Doc.ActiveView](refresh=boolean)  # package spring nodes; Selects the current document's active view. Supports more view types than the built-in option. Will be depreciated once the bult in node works with all plan types.
scale = Custom[View.Scale](view=activeView)  # package Clockwork for Dynamo 2.x; Returns the scale of a given view. ATTENTION: This node will be deprecated in 2024. As of Revit 2022, please switch to the OOTB node of the same name.

# note: "Spring nodes" Package node
# note: "Clockwork" Package node
ꟿ_collect_elementsinview = Custom[ꟿ Collect.ElementsInView](view=activeView)  # package spring nodes; Selects all elements visible in the input view.

# group: 1.2 배치된 Textnotes와 Legend Components 찾기
code_block = CodeBlock { Revit영문버젼="Text Notes"; "Legend Components"; Revit한글버젼="문자 참고"; "범례 구성요소"; }
getCategory = Element.GetCategory(element=ꟿ_collect_elementsinview)
string_from_object = FromObject(object=getCategory)
byName = Category.ByName(name=code_block.Revit한글버젼)
elements_in_view_by_category = Custom[Elements in view by category](view=activeView, category=byName)  # package MEPover; Returns all the elements in the selected view(s) by the selected categor(y)(ies)

eq = code_block.out3 == string_from_object

# group (continued): 1.2 배치된 Textnotes와 Legend Components 찾기
# note: "MEPover" Package node
filterByBoolMask = List.FilterByBoolMask(list=ꟿ_collect_elementsinview, mask=eq)

# group: 1.3 List 정리
deconstruct = List.Deconstruct(list=filterByBoolMask.in)

# group: 2.0 Component Type 정보 찾기
code_block_2 = CodeBlock { Revit영문버젼="Component Type"; Revit한글버젼="구성요소 유형"; }
getParameterValueByName = Element.GetParameterValueByName(element=deconstruct.first, parameterName=code_block_2.Revit한글버젼)
getCategory_2 = Element.GetCategory(element=getParameterValueByName)

code_block_3 = CodeBlock { Revit영문버젼="Windows"; Revit한글버젼="창"; }

# group: 2.1 사용된 Window의 룸 위치 정보 추출
all_elements_of_category = ElementsOfCategory(Category=getCategory_2)
string_from_object_2 = FromObject()  # unwired: object
sortByFunction = List.SortByFunction(list=all_elements_of_category, sortFunction=string_from_object_2)
eq_2 = getCategory_2 == code_block_3.Revit한글버젼
select_phase = RevitPhases("신축")  # graph input
rooms = Custom[Window.Rooms](window=sortByFunction, phase=select_phase)  # package Clockwork for Dynamo 2.x; Gets the rooms that are connected by a given window
# note: "Clockwork" Package node
rooms_2 = Custom[Door.Rooms](door=sortByFunction, phase=select_phase)  # package Clockwork for Dynamo 2.x; Gets the rooms that are connected by a given door

if_ = RefactoredIf(test=eq_2, true=rooms.fromRoom, false=rooms_2.fromRoom)

# group (continued): 2.1 사용된 Window의 룸 위치 정보 추출
name = Room.Name(room=if_)

# group: 2.2 룸 정보 입력
code_block_4 = CodeBlock { Revit영문버젼="Comments"; Revit한글버젼="주석"; }
# note: "LunchBox" Package node
code_block_5 = CodeBlock { " "; }
replaceNulls = Lists.Manage.ReplaceNulls(Data=name, ReplaceWith=code_block_5)
setParameterByName = Element.SetParameterByName(element=sortByFunction, parameterName=code_block_4.Revit한글버젼, value=replaceNulls)

# group: 2.3 List 정리
elementType = Element.ElementType(element=setParameterByName)
uniqueItems = List.UniqueItems(list=elementType)
count = List.Count(list=uniqueItems)

# group: 5.3 Window부재의 Instance에 기입된 룸 정보 추출
byFamilyType = FamilyInstance.ByFamilyType(familyType=uniqueItems)
code_block_6 = CodeBlock { Revit영문버젼="Comments"; Revit한글버젼="주석"; }

# note: "Rhythm" Package node
getParameterValueByNameTypeOrInstance = Rhythm.Revit.Elements.Elements.GetParameterValueByNameTypeOrInstance(element=byFamilyType, parameterName=code_block_6.Revit한글버젼)

# group: 5.4 List 정리 및 Text 내용 만들기
string_from_object_3 = FromObject(object=getParameterValueByNameTypeOrInstance)
code_block_7 = CodeBlock { ","; }
# note: "Rhythm" Package node
count_2 = List.Count(list=string_from_object_3@L2)

mergeSublists = Custom[List.MergeSublists](string_from_object_3, Character=code_block_7)  # package Spoonup; This will merge all sublists with or without a character between the strings.

# group (continued): 5.4 List 정리 및 Text 내용 만들기
code_block_8 = CodeBlock(a=mergeSublists, b=count_2) { a+"/ "+b+"개소"; }

# group: 5.1Window부재의 Type 정보 추출
code_block_9 = CodeBlock { Revit영문버젼=["Type Name","Model","Type Comments"]; Revit한글버젼=["유형 이름","모델","유형 주석"]; }

getParameterValueByNameTypeOrInstance_2 = Rhythm.Revit.Elements.Elements.GetParameterValueByNameTypeOrInstance(element=uniqueItems, parameterName=code_block_9.Revit한글버젼)

# group: 5.2 List정리
transpose = List.Transpose(lists=getParameterValueByNameTypeOrInstance_2)
string_from_object_4 = FromObject(object=transpose)

# group: 3.1 Legend Component 배열 선택
n1_legend_component_x_배열_개수 = IntegerSlider(3, range=0..100 step 1)  # "1.Legend Component (X 배열 개수)"; graph input
n3_legend_component_x열_간격 = DoubleSlider(6000, range=1500..10000 step 1)  # "3.Legend Component (X열 간격)"; graph input
n2_legend_component_y_배열_개수 = IntegerSlider(2, range=0..100 step 1)  # "2.Legend Component (Y 배열 개수)"; graph input
n4_legend_component_y열_간격 = DoubleSlider(5000, range=1000..10000 step 1)  # "4.Legend Component (Y열 간격)"; graph input
n5_component와_text_x열_간격 = IntegerSlider(3000, range=0..10000 step 100)  # "5.Component와 Text (X열 간격)"; graph input
n6_component와_text_y열_간격 = IntegerSlider(1800, range=0..10000 step 100)  # "6.Component와 Text (Y열 간격)"; graph input
n7_text와_text_y열_간격 = IntegerSlider(350, range=0..10000 step 100)  # "7.Text와 Text (Y열 간격)"; graph input

# group: 3.2 복사할 좌표 만들기
code_block_10 = CodeBlock(A=n1_legend_component_x_배열_개수, B=n3_legend_component_x열_간격) { (0..A-1)*(B); }
code_block_11 = CodeBlock(A=n2_legend_component_y_배열_개수, B=n4_legend_component_y열_간격) { -(0..A-1)*(B); }
byCoordinates = Point.ByCoordinates(x=code_block_10, y=code_block_11, lacing=CrossProduct)

# group: 3.3 List 정리
transpose_2 = Custom[Spoonup.List.Transpose](lists=byCoordinates)  # package Spoonup; to transpose list and flatten

# group: 3.3 X,Y 배열에 따른 좌표 만들기
code_block_12 = CodeBlock(행간격=n4_legend_component_y열_간격, x배열=n1_legend_component_x_배열_개수, y배열=n2_legend_component_y_배열_개수, component개수=name) { a=-3*행간격; b=(x배열*y배열); c=component개수; d=((c-b)/b); e=Math.Round(d); f=1..(e+1); g=(a*f); }
translate = Geometry.Translate(geometry=transpose_2, yTranslation=code_block_12.g, lacing=CrossProduct)
transpose_3 = Custom[Spoonup.List.Transpose](lists=translate)

# group: 3.4 List 정리
join = List.Join(list0=transpose_2, list1=translate)
asVector = Point.AsVector(point=join)
# note: "Clockwork" Package node
chop = Custom[List.Chop+](seq=asVector, lengths=count)  # package Clockwork for Dynamo 2.x; Turns a list into a list of lists with sublists of varying lengths. Unlike the OOTB node, it only takes the specified amount of items and disregards the rest of the input list.
deconstruct_2 = List.Deconstruct(list=chop)

# group: 3.5 Legend Components 복사
copyByVector = Custom[Element.CopyByVector](element=deconstruct.first, vector=deconstruct_2.rest)  # package Clockwork for Dynamo 2.x; Copies an element or a list of elements by a given vector.

# group: 3.6 List 정리
join_2 = List.Join(list0=deconstruct.first, list1=copyByVector)
flatten = List.Flatten(list=join_2)

# group: 3.7 Legend Components 정보 설정
code_block_13 = CodeBlock { Revit영문버젼="Component Type"; Revit한글버젼="구성요소 유형"; }
setParameterByName_2 = Element.SetParameterByName(element=flatten, parameterName=code_block_13.Revit한글버젼, value=uniqueItems)

# group: 4.1 배치된 Legend Components 위치 확인
boundingBox = Element.BoundingBox(element=setParameterByName_2)

ꟿ_boundingbox_midpoint = Custom[ꟿ BoundingBox.MidPoint](boundingBox=boundingBox)  # package spring nodes; Fetches the mid point of the bounding box.

# group: 4.2 설정된 좌표에 따른 Text notes 위치 설정
code_block_14 = CodeBlock(Xb=n5_component와_text_x열_간격, Yb=n6_component와_text_y열_간격) { -Xb; -Yb; }
translate_2 = Geometry.Translate(geometry=ꟿ_boundingbox_midpoint, xTranslation=code_block_14.out0, yTranslation=code_block_14.out1)
code_block_15 = CodeBlock(a=n7_text와_text_y열_간격) { b=List.Count(a); -1*(0..b)*Gap; }  # unwired: Gap
translate_3 = Geometry.Translate(geometry=translate_2, yTranslation=code_block_15.out1@L1)

# group: 5.5 TextNotes 배치 및 만들기
addItemToEnd = List.AddItemToEnd(item=code_block_8, list=string_from_object_4)
code_block_16 = CodeBlock(a=n3_legend_component_x열_간격, b=scale) { a/b; }
code_block_17 = CodeBlock { Revit영문버젼="Left"; Revit한글버젼="왼쪽"; }
default = TextNoteType.Default()
byStringAndPosition = Custom[TextNote.ByStringAndPosition](text=addItemToEnd, view=activeView, point=translate_3, width=code_block_16, textAlignFlag=code_block_17.Revit한글버젼, textNoteType=default)  # package Spoonup; Creates a text note at a given location

# group: 4.Text Notes 위치 설정
code_block_18 = CodeBlock {  }
code_block_19 = CodeBlock {  }

# group: 1.배치된 Legend Component와 Textnotes 정보 지우기
code_block_20 = CodeBlock {  }
# note: "Archi-Lab" Package node
code_block_21 = CodeBlock {  }

# group: 3.Legend Components 복사 및 배치
code_block_22 = CodeBlock {  }
code_block_23 = CodeBlock {  }

# group: 2.사용된 Window 객체의 룸 정보 추출 및 정보 입력
code_block_24 = CodeBlock {  }
code_block_25 = CodeBlock {  }

# group: 5.Text Notes 만들기
code_block_26 = CodeBlock {  }
# note: "Clockwork" Package node
code_block_27 = CodeBlock {  }

# group: 1.4 배치된 Text notes 지우기
# note: "Archi-Lab" Package node
delete = archilab.Revit.Elements.Elements.Delete(element=elements_in_view_by_category)

# group: 1.5 배치된 Legend Components 지우기
delete_2 = archilab.Revit.Elements.Elements.Delete(element=deconstruct.rest)

# group: *공지 사항
# note: 필수 다운로드 Package
# 1.Clockwork
# 2.Archi-lab.net
# 3.LunchBox
# 4.Spring nodes
# 5.Rhythm
# 6.MEPover
# 7.Ampersand
# 8.Spoonup
# 기타 문의 사항
# www.bimguidebook.co.kr
# Autodesk Korea    yong-sung.CHOI
code_block_28 = CodeBlock()
# ---------- code_block_28.designscript (15 lines) ----------
"필수 다운로드 Package

1.Clockwork
2.Archi-lab.net
3.LunchBox
4.Spring nodes
5.Rhythm
6.MEPover
7.Ampersand
8.Spoonup

기타 문의 사항
www.bimguidebook.co.kr

Autodesk Korea    yong-sung.CHOI";
# ----------------------------------------
# note: Autodesk Korea Yong-sung.choi
# Yong-sung.choi@autodesk.com
watch = Watch(code_block_28)

code_block_29 = CodeBlock {  }

# group: User Selection, Settings and Credits 사용자 선택, 설정
code_block_30 = CodeBlock {  }
code_block_31 = CodeBlock {  }

# group: Discovery and Retrieval of Information 정보 읽기, 정보 넣기,
code_block_32 = CodeBlock {  }
code_block_33 = CodeBlock {  }

# group: Creating Elements in Dynamo 다이나모 내부에서 확인 가능한 부재
code_block_34 = CodeBlock {  }
code_block_35 = CodeBlock {  }

# group: Creating Elements in Revit 레빗으로 넘어가서 표현된 부재
code_block_36 = CodeBlock {  }
code_block_37 = CodeBlock {  }

# group: Processing Data 정보 가공, 정보를 정리 및 이용
code_block_38 = CodeBlock {  }
code_block_39 = CodeBlock {  }

# group: Writing Data 결과물 (excel, shcedule 등,,,,)
code_block_40 = CodeBlock {  }
code_block_41 = CodeBlock {  }

code_block_42 = CodeBlock {  }
